# Grasshopper definition annual_daylight.gh (Grasshopper 1.0.7)

geo = Geometry([<brep referenced from the Rhino model> x2])
geo_2 = Geometry([<brep referenced from the Rhino model> x2])
geo_3 = Geometry([<brep referenced from the Rhino model> x8])
geo_4 = Geometry([<brep referenced from the Rhino model> x3])
geo_5 = Geometry(<brep referenced from the Rhino model>)
geo_6 = Geometry([<brep referenced from the Rhino model> x2])
geo_7 = Geometry([<brep referenced from the Rhino model> x2])
geo_8 = Geometry([<brep referenced from the Rhino model> x3])
geo_9 = Geometry([<brep referenced from the Rhino model> x8])
geo_10 = Geometry([<brep referenced from the Rhino model> x3])
geo_11 = Geometry([<brep referenced from the Rhino model> x2])
geo_12 = Geometry([<brep referenced from the Rhino model> x2])
geo_13 = Geometry([<brep referenced from the Rhino model> x10])
geo_14 = Geometry([<brep referenced from the Rhino model> x8])
geo_15 = Geometry([<brep referenced from the Rhino model> x3])
face = HBFace(geo=geo, name="My floors", type="Floor")  # -> report, faces; plug-in component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
face_2 = HBFace(geo=geo_2, name="My roof", type="RoofCeiling")  # -> report, faces; plug-in component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
face_3 = HBFace(geo=geo_3, name="My walls", type="Wall")  # -> report, faces; plug-in component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
face_4 = HBFace(geo=geo_4, name="Context", type="Wall")  # -> report, faces; plug-in component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
aperture = HBAperture(geo=geo_5)  # -> report, apertures; plug-in component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
geo_16 = Geometry([geo, geo_2, geo_3, geo_4])
face_5 = HBFace(geo=geo_6, name="My floors", type="Floor")  # -> report, faces; plug-in component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
face_6 = HBFace(geo=geo_7, name="My roof", type="RoofCeiling")  # -> report, faces; plug-in component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
face_7 = HBFace(geo=geo_9, name="My walls", type="Wall")  # -> report, faces; plug-in component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
face_8 = HBFace(geo=geo_10, name="Context", type="Wall")  # -> report, faces; plug-in component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
aperture_2 = HBAperture(geo=geo_8)  # -> report, apertures; plug-in component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
geo_17 = Geometry([geo_6, geo_7, geo_9, geo_10])
face_9 = HBFace(geo=geo_11, name="My floors", type="Floor")  # -> report, faces; plug-in component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
face_10 = HBFace(geo=geo_12, name="My roof", type="RoofCeiling")  # -> report, faces; plug-in component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
face_11 = HBFace(geo=geo_14, name="My walls", type="Wall")  # -> report, faces; plug-in component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
face_12 = HBFace(geo=geo_15, name="Context", type="Wall")  # -> report, faces; plug-in component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
aperture_3 = HBAperture(geo=geo_13)  # -> report, apertures; plug-in component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
geo_18 = Geometry([geo_11, geo_12, geo_14, geo_15])
wires = BrepWireframe(Brep=geo_16, Density=-1)
wires_2 = BrepWireframe(Brep=geo_17, Density=-1)
wires_3 = BrepWireframe(Brep=geo_18, Density=-1)
preview = CustomPreview(Geometry=wires, Material=ColourSwatch(SwatchColor=RGB(0, 0, 0)))
preview_2 = CustomPreview(Geometry=wires_2, Material=ColourSwatch(SwatchColor=RGB(0, 0, 0)))
preview_3 = CustomPreview(Geometry=wires_3, Material=ColourSwatch(SwatchColor=RGB(0, 0, 0)))
genpts = LBGeneratePointGrid(geometry=geo, grid_size=Slider(1, range=0.1..3), offset_dist="-0.85")  # -> points, vectors, face_areas, graft(mesh); plug-in component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
genpts_2 = LBGeneratePointGrid(geometry=geo_6, grid_size=Slider(0.75, range=0.1..3), offset_dist="-0.85")  # -> points, vectors, face_areas, graft(mesh); plug-in component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
genpts_3 = LBGeneratePointGrid(geometry=geo_11, grid_size=Slider(0.75, range=0.1..3), offset_dist="-0.85")  # -> points, vectors, face_areas, graft(mesh); plug-in component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
panel = Panel("http://climate.onebuilding.org/WMO_Region_4_North_and_Central_America/USA_United_States_of_America/NY_New_York/USA_NY_New.York-Central.Park.Observatory-Belvedere.Castle.725053_TMY3.zip")
panel_2 = Panel("http://climate.onebuilding.org/WMO_Region_4_North_and_Central_America/USA_United_States_of_America/NY_New_York/USA_NY_New.York-Central.Park.Observatory-Belvedere.Castle.725053_TMY3.zip")
panel_3 = Panel("http://climate.onebuilding.org/WMO_Region_4_North_and_Central_America/USA_United_States_of_America/NY_New_York/USA_NY_New.York-Central.Park.Observatory-Belvedere.Castle.725053_TMY3.zip")
sensorgrid = HBSensorGrid(positions=genpts.points)  # -> grid; plug-in component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
pt = Point(genpts.points)
sensorgrid_2 = HBSensorGrid(positions=genpts_2.points)  # -> grid; plug-in component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
pt_2 = Point(genpts_2.points)
sensorgrid_3 = HBSensorGrid(positions=genpts_3.points)  # -> grid; plug-in component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
pt_3 = Point(genpts_3.points)
model = HBModel(faces=flatten([face.faces, face_2.faces, face_3.faces, face_4.faces]))  # -> report, model; plug-in component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
model_2 = HBModel(faces=flatten([face_5.faces, face_6.faces, face_7.faces, face_8.faces]), apertures=flatten(aperture_2.apertures))  # -> report, model; plug-in component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
epwmap = LBEPWmap(epw_map=Toggle(False))  # -> report; plug-in component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
downloadepw = LBDownloadWeather(weather_URL=panel)  # -> epw_file, stat_file, ddy_file; plug-in component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
model_3 = HBModel(faces=flatten([face_9.faces, face_10.faces, face_11.faces, face_12.faces]), apertures=flatten(aperture_3.apertures))  # -> report, model; plug-in component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
epwmap_2 = LBEPWmap(epw_map=Toggle(False))  # -> report; plug-in component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
downloadepw_2 = LBDownloadWeather(weather_URL=panel_2)  # -> epw_file, stat_file, ddy_file; plug-in component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
panel_4 = Panel(sensorgrid_2)
epwmap_3 = LBEPWmap(epw_map=Toggle(False))  # -> report; plug-in component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
downloadepw_3 = LBDownloadWeather(weather_URL=panel_3)  # -> epw_file, stat_file, ddy_file; plug-in component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
panel_5 = Panel(sensorgrid_3)
assigngridsviews = HBAssignGridsAndViews(model=model.model, grids=flatten(sensorgrid))  # -> model; plug-in component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
assigngridsviews_2 = HBAssignGridsAndViews(model=model_2.model, grids=flatten(sensorgrid_2))  # -> model; plug-in component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
wea = HBWeaFromEPW(epw_file=downloadepw.epw_file)  # -> wea; plug-in component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
assigngridsviews_3 = HBAssignGridsAndViews(model=model_3.model, grids=flatten(sensorgrid_3))  # -> model; plug-in component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
wea_2 = HBWeaFromEPW(epw_file=downloadepw_2.epw_file)  # -> wea; plug-in component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
wea_3 = HBWeaFromEPW(epw_file=downloadepw_3.epw_file)  # -> wea; plug-in component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
importepw = LBImportEPW(epw_file=downloadepw.epw_file)  # -> location, dry_bulb_temperature, dew_point_temperature, relative_humidity, wind_speed, wind_direction, direct_normal_rad, diffuse_horizontal_rad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; plug-in component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
importepw_2 = LBImportEPW(epw_file=downloadepw_2.epw_file)  # -> location, dry_bulb_temperature, dew_point_temperature, relative_humidity, wind_speed, wind_direction, direct_normal_rad, diffuse_horizontal_rad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; plug-in component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
importepw_3 = LBImportEPW(epw_file=downloadepw_3.epw_file)  # -> location, dry_bulb_temperature, dew_point_temperature, relative_humidity, wind_speed, wind_direction, direct_normal_rad, diffuse_horizontal_rad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; plug-in component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
merge = Merge(Data1=ColourSwatch(SwatchColor=RGB(255, 255, 255)), Data2=ColourSwatch(SwatchColor=RGB(0, 255, 200)))
annualdaylight = HBAnnualDaylight(model=assigngridsviews, wea=wea, north="25", run=Toggle(False))  # -> report, results, DA, cDA, UDI, UDI_low, UDI_up; plug-in component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
annualdaylight_2 = HBAnnualDaylight(model=assigngridsviews_2, wea=wea_2, north="25", run=Toggle(False))  # -> report, results, DA, cDA, UDI, UDI_low, UDI_up; plug-in component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
legendpar = LBLegendParameters(min="0", max="100")  # -> leg_par; plug-in component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
annualdaylight_3 = HBAnnualDaylight(model=assigngridsviews_3, wea=wea_3, north="25", run=Toggle(False))  # -> report, results, DA, cDA, UDI, UDI_low, UDI_up; plug-in component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
sunpath = LBSunPath(location=importepw.location, scale=1)  # -> report, vectors, altitudes, azimuths, hoys, sun_pts, analemma, daily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; plug-in component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
legendpar_2 = LBLegendParameters(min="0", max="100")  # -> leg_par; plug-in component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
sunpath_2 = LBSunPath(location=importepw_2.location, scale=1)  # -> report, vectors, altitudes, azimuths, hoys, sun_pts, analemma, daily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; plug-in component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
legendpar_3 = LBLegendParameters(min="0", max="100")  # -> leg_par; plug-in component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
sunpath_3 = LBSunPath(location=importepw_3.location, scale=1)  # -> report, vectors, altitudes, azimuths, hoys, sun_pts, analemma, daily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; plug-in component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
heatmap = LBSpatialHeatmap(values=annualdaylight.DA, mesh=genpts.mesh, legend_par=legendpar)  # -> mesh, legend, title, colors, legend_par; plug-in component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
avr = Average(Input=annualdaylight.UDI)
avr_2 = Average(Input=annualdaylight.DA)
panel_6 = Panel(annualdaylight.report)
heatmap_2 = LBSpatialHeatmap(values=annualdaylight_2.DA, mesh=genpts_2.mesh, legend_par=legendpar_2)  # -> mesh, legend, title, colors, legend_par; plug-in component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
avr_3 = Average(Input=annualdaylight_2.UDI)
avr_4 = Average(Input=annualdaylight_2.DA)
panel_7 = Panel(annualdaylight_2.report)
heatmap_3 = LBSpatialHeatmap(values=annualdaylight_3.UDI, mesh=genpts_3.mesh, legend_par=legendpar_3)  # -> mesh, legend, title, colors, legend_par; plug-in component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
avr_5 = Average(Input=annualdaylight_3.UDI)
avr_6 = Average(Input=annualdaylight_3.DA)
panel_8 = Panel(annualdaylight_3.report)
panel_9 = Panel(avr)
panel_10 = Panel(avr_2)
panel_11 = Panel(avr_3)
panel_12 = Panel(avr_4)
panel_13 = Panel(avr_5)
panel_14 = Panel(avr_6)
