# Grasshopper definition Ladybug_sunlight_analysis 2021_22_lv.gh (Grasshopper 1.0.7)

epw_url = Panel("https://energyplus-weather.s3.amazonaws.com/europe_wmo_region_6/NLD/NLD_Amsterdam.062400_IWEC/NLD_Amsterdam.062400_IWEC.zip")
# Retrieve the EPW data
# Double-click on False
go_to_epw_website = BooleanToggle(False)
epwmap = LBEPWmap(epw_map=go_to_epw_website)  # -> Output; plug-in component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
downloadepw = LBDownloadWeather(weather_URL=epw_url)  # -> epw_file, stat_file, ddy_file; plug-in component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

# ----
# Extract the EPW data
importepw = LBImportEPW(epw_file=downloadepw.epw_file)  # -> location, dry_bulb_temperature, dew_point_temperature, relative_humidity, wind_speed, wind_direction, direct_normal_rad, diffuse_horizontal_rad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; plug-in component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
month = Slider(5, range=0..10)
day = Slider(21, range=0..100)
hour = Slider(9, range=0..100)
month_2 = Slider(7, range=0..10)
day_2 = Slider(30, range=0..100)
hour_2 = Slider(22, range=0..100)

# ----
# Set the analysis period
month_3 = Slider(7, range=0..10)
day_3 = Slider(21, range=0..100)
hour_3 = Slider(8, range=0..100)
analysisperiod = LBAnalysisPeriod(start_month=month, start_day=day, start_hour=hour, end_month=month_2, end_day=day_2, end_hour=hour_2)  # -> period, hoys, dates; plug-in component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
hoy = LBCalculateHOY(month=month_3, day=day_3, hour=hour_3)  # -> flatten(hoy), flatten(doy), flatten(date); plug-in component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

# ----
# Change legend settings
# HERE -->
construct_domain = ConstructDomain(DomainStart=0, DomainEnd=1)
legend_steps = Slider(10, range=0..10)
range = Range(Domain=construct_domain, Steps=legend_steps)
# Set the legend color
gradient = Gradient(LowerLimit=0, UpperLimit=1, Parameter=range, stops=[0: RGB(0, 0, 0), 1: RGB(255, 255, 255)])
legend_size = Slider(1000, range=0..10000)
location_legend = BooleanToggle(True)
legendpar = LBLegendParameters(colors=gradient, vert_or_horiz=location_legend, seg_height=legend_size)  # -> leg_par; plug-in component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

scale = Panel("0.25")

sunpath_type = ValueList({"Orthographic", "Stereographic", "3D": None}, selected="3D")
# Create the sunpath
true_north_in_relation_to_y_axis = Panel("60")
sunpath = LBSunPath(
    north=true_north_in_relation_to_y_axis,
    location=importepw.location,
    hoys=analysisperiod.hoys,
    scale=scale,
    projection=sunpath_type)  # -> out, vectors, altitudes, azimuths, hoys, sun_pts, analemma, daily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; plug-in component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

pipeline = GeometryPipeline(
    GroupByLayer=False,
    GroupByType=False,
    IncludeHidden=True,
    IncludeLocked=True,
    LayerFilter="obs",
    NameFilter="*",
    SublayerFiltering=True,
    TypeFilter=1073741848)
geo = Geometry(sunpath.sun_pts)

# ----
# Surface to calculate
# Context geometry
geometry = Geometry(pipeline)
surface = Surface(<surface referenced from the Rhino model>)

multicore_processing = BooleanToggle(False)
run_the_calculation = BooleanToggle(True)
offset_height = Slider(700, range=0..1000)
grid_size = Panel("1000")
# Calculate sun hours
directsunhours = LBDirectSunHours(
    vectors=flatten(sunpath.vectors),
    geometry=flatten(surface),
    context=flatten(geometry),
    grid_size=grid_size,
    offset_dist=offset_height,
    legend_par=legendpar,
    parallel=multicore_processing,
    run=run_the_calculation)  # -> out, points, results, mesh, legend, title, int_mtx; plug-in component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

# ----
# Calculate total amount
# of sun hours
pt = Point(directsunhours.points)

mass_addition = MassAddition(Input=directsunhours.results)  # -> Result, PartialResults
total_hours_of_sunlight = Panel(mass_addition.Result)

mesh = Mesh(directsunhours.mesh)
