# Grasshopper definition direct_sunhours.gh (Grasshopper 1.0.7)

panel = Panel("https://energyplus-weather.s3.amazonaws.com/north_and_central_america_wmo_region_4/USA/NY/USA_NY_New.York.City-Central.Park.94728_TMY/USA_NY_New.York.City-Central.Park.94728_TMY.zip")
downloadepw = LBDownloadWeather(weather_URL=panel)  # -> epw_file, stat_file, ddy_file; plug-in component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
epwmap = LBEPWmap(epw_map=Toggle(False))  # -> report; plug-in component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
importepw = LBImportEPW(epw_file=downloadepw.epw_file)  # -> location, dry_bulb_temperature, dew_point_temperature, relative_humidity, wind_speed, wind_direction, direct_normal_rad, diffuse_horizontal_rad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; plug-in component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
hoy = LBCalculateHOY(month=Slider(3, range=1..12), day=Slider(1, range=1..31), hour=Slider(11, range=0..23), minute=Slider(0, range=0..59))  # -> flatten(hoy), flatten(doy), flatten(date); plug-in component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
analysisperiod = LBAnalysisPeriod(
    start_month=Slider(6, range=1..12),
    start_day=1,
    start_hour=Slider(7, range=0..23),
    end_month=Slider(7, range=1..12),
    end_hour=Slider(15, range=0..23))  # -> period, hoys, dates; plug-in component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
sunpath = LBSunPath(location=importepw.location, hoys=analysisperiod.hoys, scale=1)  # -> report, vectors, altitudes, azimuths, hoys, sun_pts, analemma, daily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; plug-in component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
range = Range(Domain=Domain(0, 1), Steps=10)
vdis = VectorDisplay(Anchor=sunpath.sun_pts, Vector=sunpath.vectors)
dots = DotDisplay(Point=sunpath.sun_pts, Colour=RGB(0, 0, 0), Size=1)
gradient = Gradient(LowerLimit=0, UpperLimit=1, Parameter=range, stops=[0.15: RGB(255, 255, 255), 0.85: RGB(220, 0, 40)])
pipeline = GeometryPipeline(
    GroupByLayer=False,
    GroupByType=False,
    IncludeHidden=True,
    IncludeLocked=True,
    LayerFilter="study_srf",
    SublayerFiltering=True,
    TypeFilter=1073741848)
pipeline_2 = GeometryPipeline(
    GroupByLayer=False,
    GroupByType=False,
    IncludeHidden=True,
    IncludeLocked=True,
    LayerFilter="context",
    NameFilter="*",
    SublayerFiltering=True,
    TypeFilter=1073741848)
pipeline_3 = GeometryPipeline(
    GroupByLayer=False,
    GroupByType=False,
    IncludeHidden=True,
    IncludeLocked=True,
    LayerFilter="design_geo",
    NameFilter="*",
    SublayerFiltering=True,
    TypeFilter=1073741848)
colrange = LBColorRange(index=Slider(22, range=0..23))  # -> colors; plug-in component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
geo = Geometry(flatten([pipeline_2, pipeline_3]))
number_slider = Slider(2, range=0.25..2)
legendpar = LBLegendParameters(colors=gradient, vert_or_horiz=Toggle(True))  # -> leg_par; plug-in component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
geo_2 = Geometry(pipeline)
geo_3 = Geometry(geo)
directsunhours = LBDirectSunHours(
    vectors=flatten(sunpath.vectors),
    geometry=flatten(geo_2),
    context=flatten(geo_3),
    grid_size=Slider(2, range=0.1..10),
    offset_dist=Slider(2, range=0..10),
    legend_par=legendpar,
    run=Toggle(True))  # -> report, points, results, mesh, legend, title, int_mtx; plug-in component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
wires = BrepWireframe(Brep=geo_2, Density=-1)
preview = CustomPreview(Geometry=wires, Material=ColourSwatch(SwatchColor=RGB(255, 0, 255)))
pt = Point(directsunhours.points)
mesh = Mesh(directsunhours.mesh)
